# Grasshopper definition 2025_07-23 AutoViewClipper.gh (Grasshopper 1.0.8)
# plug-ins: RhinoCodePluginGH, Human

panel = Panel("STEP 01")
layertable = LayerTable(Update=Button(), AutoUpdate=Button())  # -> Layers, FullLayerPaths, LayerColors, Linetypes, MaterialNames, Visible, PrintWidth, PrintColor
panel_2 = Panel(layertable.Layers)
series = Series(Start=Slider(12, range=12..35), Step=1, Count=Slider(24, range=0..24))
panel_3 = Panel("14")
item = ListItem(List=layertable.Layers, Index=series, Wrap=True)
lng = ListLength(List=item)
dup = DuplicateData(Data=Toggle(False), Number=expr("x-1", lng), Order=True)
panel_4 = Panel("C:\Users\aaliaj\Desktop\00_CODING\Arch.FLW-StudentHousing\Assets_RefImages\BulkScreenCaps")
ins = InsertItems(List=dup, Item=Toggle(True), Indices=Slider(23, range=0..23), Wrap=True)
panel_5 = Panel(item)
layers = CreateModifyLayers(LayerName=item, Visibility=ins, DeleteLayer=False, enableFullPath=False)  # -> LayerNames, LayerFullPath
gate = StreamGate(Stream=Button(), Gate=Toggle(True))  # -> Target0, Target1
file_patth = FilePath(panel_4)
button = Button()  # disabled
file_patth_2 = FilePath("C:\Users\Alvi\Desktop\Amenta Emma\2025_06-12 Rhino Tutoirals\EXAMPLE_FLW_STUDENTHOUSING\")  # disabled
c_viewcapturetofile = CSharpScript(trigger=button, FilePathPicture=file_patth_2)  # -> out, A; disabled
# ---------- c_viewcapturetofile: C# ----------
using System;
using System.IO;
using Rhino;
using Rhino.Display;

// Inputs:
// bool trigger - connect a button here
// string FilePathToSaveTo - folder path to save the image

// Outputs:
// A - result message

// Cast input from object to bool
bool triggerPressed = (bool)trigger;

if (triggerPressed)
{
  var doc = RhinoDoc.ActiveDoc;
  var view = doc.Views.ActiveView;
  
  if (view == null)
  {
    A = "No active view found";
    return;
  }

  var view_capture = new ViewCapture
  {
    Width = view.ActiveViewport.Size.Width,
    Height = view.ActiveViewport.Size.Height,
    ScaleScreenItems = false,
    DrawAxes = false,
    DrawGrid = false,
    DrawGridAxes = false,
    TransparentBackground = true
  };

  var bitmap = view_capture.CaptureToBitmap(view);
  
  if (bitmap != null)
  {
    // Create filename with timestamp to avoid overwriting
    var timestamp = DateTime.Now.ToString("yyyyMMdd_HHmmss");
    var path = Environment.GetFolderPath(Environment.SpecialFolder.Desktop);
    var filename = Path.Combine(path, $"ViewCapture_{timestamp}.png");
    
    try
    {
      bitmap.Save(filename, System.Drawing.Imaging.ImageFormat.Png);
      A = $"View captured successfully: {filename}";
      bitmap.Dispose(); // Clean up memory
    }
    catch (Exception ex)
    {
      A = $"Error saving file: {ex.Message}";
    }
  }
  else
  {
    A = "Failed to capture view";
  }
}
else
{
  A = "Press button to capture view";
}
# ---------- end c_viewcapturetofile ----------
c_viewcapturetofile_r1 = CSharpScript(trigger=gate.Target1, FilePathPicture=file_patth)  # -> out, A
# ---------- c_viewcapturetofile_r1: C# ----------
using System;
using System.IO;
using Rhino;
using Rhino.Display;

// Inputs:
// bool trigger - connect a button here
// string FilePathToSaveTo - folder path to save the image

// Outputs:
// A - result message

// Cast input from object to bool
bool triggerPressed = (bool)trigger;

if (triggerPressed)
{
  var doc = RhinoDoc.ActiveDoc;
  
  // Find the perspective view specifically
  var view = doc.Views.Find("Perspective", false);
  
  if (view == null)
  {
    A = "Perspective view not found";
    return;
  }

  var view_capture = new ViewCapture
  {
    Width = view.ActiveViewport.Size.Width,
    Height = view.ActiveViewport.Size.Height,
    ScaleScreenItems = false,
    DrawAxes = false,
    DrawGrid = false,
    DrawGridAxes = false,
    TransparentBackground = true
  };

  var bitmap = view_capture.CaptureToBitmap(view);
  
  if (bitmap != null)
  {
    // Create filename with timestamp to avoid overwriting
    var timestamp = DateTime.Now.ToString("yyyyMMdd_HHmmss");
    // With this:
    var filePath = (string)FilePathPicture;
    var path = File.Exists(filePath) ? Path.GetDirectoryName(filePath) : filePath;
    var filename = Path.Combine(path, $"ViewCapture_{timestamp}.png");
    
    try
    {
      bitmap.Save(filename, System.Drawing.Imaging.ImageFormat.Png);
      A = $"View captured successfully: {filename}";
      bitmap.Dispose(); // Clean up memory
    }
    catch (Exception ex)
    {
      A = $"Error saving file: {ex.Message}";
    }
  }
  else
  {
    A = "Failed to capture view";
  }
}
else
{
  A = "Press button to capture view";
}
# ---------- end c_viewcapturetofile_r1 ----------
panel_6 = Panel(c_viewcapturetofile.out)  # disabled
panel_7 = Panel(c_viewcapturetofile.A)  # disabled
panel_8 = Panel(c_viewcapturetofile_r1.out)
panel_9 = Panel(c_viewcapturetofile_r1.A)
